vi "802.11 Host Retransmission.gvi"   [LabVIEW NXG]
inputs:
  "RT Queue In": Queue<u8[]>
  "RT Limit": u32 = 100000
  "# of ACK Received": u32
  "# of ACK Timeout": u32
  "Packet Expired?": bool
  "Error In": error
  "Deficit 1": f64
  "Deficit 2": f64
  "Destination 1 MAC": u8[6]
outputs:
  "RT Queue Out": Queue<u8[]>
  "RT payload": u8[]
  "timed out?": bool
  "RT Number": u8
  "Error Out": error
  "Deficit 2 out": f64
  "Deficit 1 out": f64
  "Packet dropped": bool
panel indicators:
  "State": T1
types:
  T1 = enum{"Idle", "ACK Received", "ACK Timeout and Packet Valid", "ACK Timeout and Packet Expires"}
diagram:
  # Case loop in triggered by
  # (1) # of ACK Received increases
  # (2) # of ACK Timeout increases
  Feedback Node(Input=w1) -> (Output=w2)
  Is Greater(x=$"# of ACK Received", y=w2) -> w3
  Feedback Node(Input=w4) -> (Output=w5)
  Is Greater(x=$"# of ACK Timeout", y=w5) -> w6
  Logical Or(w3, w6) -> w7
  Select(s=$"Packet Expired?", t="ACK Timeout and Packet Expires", f="ACK Timeout and Packet Valid") -> w8
  Select(s=w3, t="ACK Received", f=w8) -> w9
  Select(s=w7, t=w9, f="Idle") -> w10
  case (w10) {
    frame "Idle", Default {
      w1 = $"# of ACK Received"
      w4 = $"# of ACK Timeout"
      w11 = $"RT Queue In"
      w12 = default
      w13 = TRUE
      w14 = default
      w15 = $"Error In"
      w16 = $"Deficit 1"
      w17 = $"Deficit 2"
      w18 = TRUE
    }
    frame "ACK Received" {
      # If ACK received, dequeue current packet & decrement deficit
      Dequeue Element(error in (no error)=$"Error In", queue=$"RT Queue In", timeout in ms (-1)=0) -> (element=w19, error out=w20, queue out=w21)
      Flush Queue(error in (no error)=w20, queue=w21) -> (error out=w15, queue out=w11)
      call "Deficit Decrement.gvi"(Deficit 1=$"Deficit 1", Deficit 2=$"Deficit 2", payload=w19, Destination 1 MAC=$"Destination 1 MAC") -> (Deficit 1 out=w16, Deficit 2 out=w17)
      w1 = $"# of ACK Received"
      w4 = $"# of ACK Timeout"
      w12 = default
      w13 = TRUE
      w14 = default
      w18 = TRUE
    }
    frame "ACK Timeout and Packet Valid" {
      Dequeue Element(error in (no error)=$"Error In", queue=$"RT Queue In", timeout in ms (-1)=0) -> (element=w12, error out=w22, queue out=w11, timed out?=w13)
      Array Index(array=w12) -> (out0[4]=w23)
      Increment(x=w23) -> w14
      Replace Array Subset(inArray=w12, 4, w14) -> w24
      # Dequeue and Enqueue
      # again for RT
      Enqueue Element At Opposite End(element=w24, error in (no error)=w22, queue=$"RT Queue In") -> (error out=w15)
      w1 = $"# of ACK Received"
      w4 = $"# of ACK Timeout"
      w16 = $"Deficit 1"
      w17 = $"Deficit 2"
      w18 = FALSE
    }
    frame "ACK Timeout and Packet Expires" {
      Dequeue Element(error in (no error)=$"Error In", queue=$"RT Queue In", timeout in ms (-1)=0) -> (element=w25, error out=w26, queue out=w27)
      # If packet expires, then dequeue the current packet anyway
      Flush Queue(error in (no error)=w26, queue=w27) -> (error out=w15, queue out=w11)
      call "Deficit Increment.gvi"(Destination 1 MAC=$"Destination 1 MAC", payload=w25, Deficit 1=$"Deficit 1", Deficit 2=$"Deficit 2") -> (Deficit 1 out=w16, Deficit 2 out=w17)
      w1 = $"# of ACK Received"
      w4 = $"# of ACK Timeout"
      w12 = default
      w13 = TRUE
      w14 = default
      w18 = TRUE
    }
  }
  # Last Modified by Ping-Chun
  # 09/01/2016
  $"Packet dropped" <- w18
  $"RT Queue Out" <- w11
  $"RT payload" <- w12
  $"Error Out" <- w15
  $"timed out?" <- w13
  $"RT Number" <- w14
  $"Deficit 1 out" <- w16
  $"Deficit 2 out" <- w17
  $State <- w10
