vi "802.11 Host.gvi"   [LabVIEW NXG]
outputs:
  "Overwritten by Device MAC Address": bool
panel controls:
  "Trigger TX": bool
  "Clear events": bool
  "Operation Mode": T2 = "RF Multi Station"
  "Primary Subband": UFXP(2.0) = 1
  "Transmit IP Address": string = "127.0.0.1"
  "Transmit Port": u16 = 12346
  "Receive Port": u16 = 12345
  "Tab": i32
  "Power Level [dBm]": f64 = 10
  "TX Frequency [Hz]": f64 = 2500000000
  "Destination MAC Address 1": u8[6] = [71, 111, 75, 117, 109, 98]
  "Device MAC Address": u8[6] = [71, 111, 75, 117, 109, 97]
  "TX Port (USRP only)": enum{"TX1/RF 0", "TX1/RF 1"} = "TX1/RF 0"
  "RX Port (USRP only)": T3 = "RX2/RF 1"
  "AGC": bool = TRUE
  "Manual RX gain [dB]": f64 = 37.5
  "PN Data Packet Size": i32 = 2000
  "Subcarrier Format": i32 = "20 MHz (IEEE 802.11 a)"(0)
  "Stop": bool
  "RIO Device": string = "RIO0"
  "Station": bool = TRUE
  "reset TX staistics": bool
  "reset RX staistics": bool
  "Transmit ACK": bool = TRUE
  "Backoff": u16 = 4
  "All": bool
  "None": bool
  "Events to Track": T4
  "CCA Energy Detection Threshold [dBm]": FXP(10.3) = -72
  "MCS": UFXP(4.0) = 6
  "Data Source Option": i32 = 1
  "Data Sink Options": i32
  "Data Source": enum{"UDP", "PN Data", "Manual"} = "PN Data"
  "Data Sink": enum{"Off", "UDP"} = "Off"
  "Reference Clock": string = "Internal"
  "Receive Port 2": u16 = 12346
  "FPGA MAC Controls": cluster{"time to wait for ACK": u32} = {"time to wait for ACK"=700}
  "Destination MAC Address 2": u8[6] = [71, 111, 75, 117, 109, 99]
  "Receive Port 3": u16 = 12347
  "Receive Port 4": u16 = 12348
  "interarrival time": u32 = 5
  "deadline": u32 = 5
  "loop count": i32 = 1
  "session": T20 = {"USRP session"={"EEPROM Header"={"Number of Reserved Bytes"=9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}, "Device Data Header"={"Number of Reserved Bytes"=27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}, "EEPROM Characterization Header"={"Number of Reserved Bytes"=28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}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}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}
  "Deficit1 file path": path = path "C:\\Users\\AM-Droider 2\\Desktop\\Results\\DBQ with LQF\\deficit1.txt"
  "Deficit2 file path": path = path "C:\\Users\\AM-Droider 2\\Desktop\\Results\\DBQ with LQF\\deficit2.txt"
  "Elastic1 QL file path": path = path "C:\\Users\\AM-Droider 2\\Desktop\\Results\\DBQ with LQF\\elastic1.txt"
  "Elastic2 QL file path": path = path "C:\\Users\\AM-Droider 2\\Desktop\\Results\\DBQ with LQF\\elastic2.txt"
  "Store Results": bool
  "Deficit1 Store Queue": Queue<f64[]>
  "Deficit2 Store Queue": Queue<f64[]>
  "QL1 Store Queue": Queue<u32[]>
  "QL2 Store Queue": Queue<u32[]>
panel indicators:
  "Events": string
  "MAC TX Statistic": T1
  "Coerced LO frequency TX [Hz]": f64
  "Coerced LO frequency RX [Hz]": f64
  "Coerced Power Level [dBm]": f64
  "Coerced RX Gain [dB]": f64
  "RX Throughput [bits/s]": f64
  "Current TX Block Error Rate (BLER)": f64
  "RX Frequency [Hz]": f64
  "Station Active": bool
  "Device Ready": bool
  "ADC headroom [dBFS]": f64
  "Data Transfer": bool
  "FIFO Full": bool
  "FIFO Full": bool
  "Data Transfer": bool
  "Target RX gain [dB]": f64
  "compensated CFO [Hz]": f64
  "TX Data Dropped": bool
  "modulation and coding rate": string
  "MAC RX Statistic": T5
  "Target FIFO Overflow": bool
  "Data Transfer 2": bool
  "RT Number": u8
  "TX Size": i32
  "Deficit 1": f64
  "Deficit 2": f64
  "Packet Dropped?": bool
  "Data Transfer 4": bool
  "Data Transfer 3": bool
  "loop iteration generate": i32
  "loop iteration send": i32
  "number elements in queue": i32
  "number elements in queue_2": i32
  "Data Logging Completed": bool
types:
  T1 = cluster{"TX after SIFS Requests Detected": u32, "TX after SIFS Requests Completed": u32, "TX after Backoff Requests Detected": u32, "TX after Backoff Requests Completed": u32}
  T2 = enum{"Baseband Loopback", "RF Loopback", "RF Multi Station"}
  T3 = enum{"RX1/RF 0", "RX2/RF 0", "RX1/RF 1", "RX2/RF 1"}
  T4 = cluster{"PhyTxStart": bool, "PhyTxEnd": bool, "PhyRxStart": bool, "PhyRxEnd": bool, "MacChannelState": bool, "MacTxStatus": bool, "PhyCcaTiming": bool}
  T5 = cluster{"Packet Starts detected": u32, "Frames from PHY": u32, "Frames with FCS pass": u32, "ACKs Received": u32}
  T6 = cluster{"Timestamp": u32, "Transferred Bytes": u32}
  T7 = cluster{"fpga ref": any, "bus instance": u32, "instruction FIFO depth": u32, "executing on FPGA target": bool, "show error call chain": bool}
  T8 = cluster{"Gain Imbalance [linear]": f64, "Phase Imbalance [radians]": f64, "Offset": c128}
  T9 = cluster{"Actual Gain [dB]": f64, "Attenuation Table Index": i32}
  T10 = cluster{"Attenuation Table [dB]": f64[][], "Frequencies [Hz]": f64[], "IQ Imbalance Table": T8[], "Gain Table": T9[][]}
  T11 = cluster{"power enable": bool, "mixer enable": bool, "gain": u8}
  T12 = enum{"TX/RX transmits and RX2 receives", "TX/RX receives and RX2 is unused"}
  T13 = cluster{"LO lpf enable": bool, "rx.configuration": T11, "tx.configuration": T11, "antenna configuration": T12}
  T14 = cluster{"lo frequency": u64, "ADC gain": u8, "ATR state data": T13[]}
  T15 = cluster{"Checksum": u32, "Product Code": u16, "Hardware Current Version": u16, "Hardware Oldest Compatible Version": u16, "EEPROM Map Current Version": u16, "EEPROM Map Oldest Compatible Version": u16, "User Password": string, "Pointer to Factory Header": u32, "Pointer to User Header": u32, "Recommended Interval": u16, "Number of Reserved Bytes": i32, "Number of Daughterboards": u8, "Daughterboard IDs": u16[], "Daughterboard Serial Numbers": string[]}
  T16 = cluster{"Checksum": u32, "Number of Channels": u8, "Number of Gain Settings": u16[], "Pointer to Characterization Data": u32[], "Number of Reserved Bytes": i32, "Number of Frequencies": u16[]}
  T17 = cluster{"Checksum": u32, "Date": timestamp, "Temperature": f32, "Misc. Info": string, "Pointer to Device Data Header": u32, "Number of Reserved Bytes": i32}
  T18 = cluster{"Gains[dB]": f64[], "Frequencies [Hz]": f64[], "IQ Imbalance Table": T8[], "Measured Gains[dB]": f64[][]}
  T19 = cluster{"FPGA Interface": any, "RIO Interface Number": u32, "Data Clock Rate": u32, "FPGA Data Clock Rate": u32, "Global Settings Register Bus": Queue<T7>, "Radio 0 Settings Register Bus": Queue<T7>, "Radio 1 Settings Register Bus": Queue<T7>, "Radio Settings Bus Semaphore": i32, "DB Queues": Queue<T14>[], "Characterization Data Valid?": bool, "EEPROM Header": T15, "Device Data Header": T16, "EEPROM Characterization Header": T17, "Characterization Data": T18[], "FPGA Current Version": u32, "FPGA Oldest Compatible Version": u32, "Fixed Logic Current Version": u32, "Fixed Logic Oldest Compatible Version": u32, "FPGA Radio Settings Bus Current Version": u32, "FPGA Radio Settings Bus Oldest Compatible Version": u32, "FPGA Board Config Current Version": u32, "FPGA Board Config Oldest Compatible Version": u32}
  T20 = cluster{"FPGA interface": any, "stop queue": Queue<bool>, "send queue": Queue<u8[]>, "receive queue": Queue<u8[]>, "receive throughput queue": Queue<T6>, "UDP Receiver": UdpNetworkConnectionRefnum, "PN packet": u8[], "FlexRIO session": Queue<T7>, "FlexRIO TX Characterization Data": T10, "FlexRIO RX Characterization Data": T10, "USRP session": T19, "send queue 2": Queue<u8[]>, "UDP Receiver 2": UdpNetworkConnectionRefnum, "send queue 3": Queue<u8[]>, "send queue 4": Queue<u8[]>, "RT queue": Queue<u8[]>}
  T21 = cluster{"TX after SIFS requests detected": u32, "TX after SIFS requests completed": u32, "TX after backoff requests detected": u32, "TX after backoff requests completed": u32}
  T22 = cluster{"Frames detected": u32, "Subframes received": u32, "Valid subframes received": u32, "ACKs received": u32}
  T23 = cluster{"remove header": bool, "block unsupported frame types": bool, "block FCS errors": bool, "block address mismatch": bool, "block header recognize error": bool}
diagram:
  w1 = -44332211  # code
  sequence {
    frame 0 {
      $Events <- EmptyString
      $"Device Ready" <- FALSE
      $"Station Active" <- FALSE
      $Station <- FALSE
      $"MAC TX Statistic" <- T21 {all zero or empty}
      $"MAC RX Statistic" <- T22 {all zero or empty}
      $"Current TX Block Error Rate (BLER)" <- 0
      $"RX Throughput [bits/s]" <- 0
      $"compensated CFO [Hz]" <- 0
      for (N = 100) (after NaN) {
      }
      Initialize Array(element=NaN, size=100, size=2)
      Obtain Queue(element data type=f64[2] [0, 0], max queue size (-1, unlimited)=-1, name (unnamed)="Deficit1 Store Queue") -> (queue out=w2)
      $"Deficit1 Store Queue" <- w2
      Obtain Queue(element data type=f64[2] [0, 0], max queue size (-1, unlimited)=-1, name (unnamed)="Deficit2 Store Queue") -> (queue out=w3)
      $"Deficit2 Store Queue" <- w3
      Obtain Queue(element data type=u32[2] [0, 0], name (unnamed)="QL1 Store Queue") -> (queue out=w4)
      $"QL1 Store Queue" <- w4
      Obtain Queue(element data type=u32[2] [0, 0], name (unnamed)="QL2 Store Queue") -> (queue out=w5)
      $"QL2 Store Queue" <- w5
      $"Deficit 1" <- 0
      $"Deficit 2" <- 0
    }
  }
  call "802.11 Host Init.gvi"(device=$"RIO Device", error in=no error, Reference Clock=$"Reference Clock") -> (session out=w6, error out=w7)
  case (w7) {
    frame Error {
      w8 = w7
    }
    frame No Error {
      $"Device Ready" <- TRUE
      $session <- w6
      w8 = w7
    }
  }
  s1 = w8  # shift register
  while {
    # RX Reception
    call "802.11 Unbundle Session.gvi"(session_2=$session) -> (FPGA interface=w9, receive queue=w10, receive throughput queue=w11)
    call "802.11 Receive RX ICP.gvi"(FPGA interface=w9, error in=s1, receive queue=w10, receive throughput queue=w11, enqueue decoded data=$"Station Active") -> (error out=w12)
    call "Check Stop.gvi"(error in=w12) -> (error out=w13, stop=w14)
    Wait Until Next Ms Multiple(millisecond multiple=0)
    next s1 = w13
    stop if w14
  }
  call "Stop On Error.gvi"(error in=s1) -> (error out=w15)
  s2 = w8  # shift register
  s3 = string[] []  # shift register
  while {
    # update plots and indicators (slow)
    call "802.11 Unbundle Session.gvi"(session_2=$session) -> (FPGA interface=w16)
    call "802.11 Read Event FIFO.gvi"(FPGA interface=w16, error in=s2) -> (raw events=w17, error out=w18)
    call "802.11 Read Target Registers.gvi"(FPGA interface=w16, error in=s2) -> (error out=w19, target FIFO overflow=w20, compensated CFO=w21, MAC RX statistics=w22, MAC TX statistics=w23)
    call "Configure FPGA MAC.gvi"(FPGA Reference In=w16, FPGA MAC Controls=$"FPGA MAC Controls", error in=s2) -> (error out=w24)
    Merge Errors(w19, w18, w24) -> (error out=w25)
    call "Check Stop.gvi"(error in=w25) -> (error out=w26, stop=w27)
    $"Target FIFO Overflow" <- w20
    $"compensated CFO [Hz]" <- w21
    $"MAC RX Statistic" <- w22
    $"MAC TX Statistic" <- w23
    call "802.11 Events to String.gvi"(event data=w17, events to track=$"Events to Track") -> (event strings=w28)
    Build Array[ConcatenateInputs=True](s3, w28) -> w29
    Delete From Array(inArray=w29, length (1)=100) -> (deleted=w30)
    Select(s=$"Clear events", t=string[] [], f=w30) -> w31
    Concatenate Strings(w30) -> w32
    $Events <- w32
    Select(s=$None, t=T4 {all zero or empty}, f=$"Events to Track") -> w33
    w34 = T4 {"PhyTxStart"=TRUE, "PhyTxEnd"=TRUE, "PhyRxStart"=TRUE, "PhyRxEnd"=TRUE, "MacChannelState"=TRUE, "MacTxStatus"=TRUE, "PhyCcaTiming"=TRUE}
    Select(s=$All, t=w34, f=w33) -> w35
    $"Events to Track" <- w35
    Wait Until Next Ms Multiple(millisecond multiple=1000)
    next s2 = w26
    next s3 = w31
    stop if w27
  }
  call "Stop On Error.gvi"(error in=s2) -> (error out=w36)
  s4 = w8  # shift register
  while {
    Feedback Node(Input=$"Station Active") -> (Output=w37)
    Is Not Equal(x=$"Station Active", y=w37) -> w38
    # update plots and indicators (fast)
    case ($"Station Active") {
      frame False, Default {
        w39 = s4
      }
      frame True {
        call "802.11 Unbundle Session.gvi"(session_2=$session) -> (FPGA interface=w40, receive throughput queue=w41)
        call "802.11 Prepare Throughput Measurements.gvi"(reset=w38, FPGA interface=w40, receive throughput queue=w41, error in=s4, timing granularity=1000) -> (error out=w39, TX block error rate=w42, RX throughput=w43)
        $"Current TX Block Error Rate (BLER)" <- w42
        Divide(x=w43, y=1000000)
      }
    }
    call "Check Stop.gvi"(error in=w39) -> (error out=w44, stop=w45)
    Wait Until Next Ms Multiple(millisecond multiple=1000)
    next s4 = w44
    stop if w45
  }
  call "Stop On Error.gvi"(error in=s4) -> (error out=w46)
  Udp Open(error in (no error)=w8, net address=0, port=0, service name="", timeout ms (25000)=25000) -> (connection ID=w47, error out=w48)
  call "Set Socket Option.gvi"(connection in=w47, level=0xFFFF, option name=0x1001, value=1024000, error in=w48) -> (error out=w49, connection out=w50)
  w51 = $"Destination MAC Address 1"
  s5 = w49  # shift register
  s6 = w50  # shift register
  while (iteration -> i1) {
    Wait Until Next Ms Multiple(millisecond multiple=0)
    # UDP send and receive
    call "802.11 Unbundle Session.gvi"(session_2=$session) -> (send queue=w52, receive queue=w53, UDP receiver=w54, PN packet=w55, UDP Receiver 2=w56, send queue 2=w57, send queue 3=w58, send queue 4=w59)
    case ($"Station Active") {
      frame False, Default {
        w60 = s5
        w61 = s6
      }
      frame True {
        Array Subset(array=w55, length0=$"PN Data Packet Size") -> w62
        Is Equal(x=$"Data Sink", y="UDP") -> w63
        call "802.11 Send UDP Data.gvi"(target port=$"Transmit Port", target IP address=$"Transmit IP Address", receive queue=w53, UDP sender=s6, enable=w63, error in=s5) -> (FIFO full=w64, error out=w65, UDP sender dup=w61, data transfer=w66)
        case ($"Data Source") {
          frame "UDP" {
            # UDP
            call "802.11 Receive UDP Data.gvi"(UDP receiver=w54, send queue=w52, error in=s5, UDP Receiver 2=w56, send queue 2=w57, send queue 3=w58, send queue 4=w59, Destination MAC 1=$"Destination MAC Address 1", Destination MAC 2=$"Destination MAC Address 2") -> (data transfer=w68, error out=w67, FIFO full=w73, data transfer 2?=w69, data transfer 4?=w70, data transfer 3?=w71)
            $"FIFO Full" <- w73
            w72 = default
          }
          frame "PN Data" {
            # PN data
            call "802.11 Send PN Data.gvi"(interarrival time=$"interarrival time", send queue 2=w57, Destination MAC Address 1=w51, send queue=w52, PN data=w62, error in=w65, Destination MAC Address 2=$"Destination MAC Address 2", send queue 3=w58, send queue 4=w59, deadline=$deadline, loop count=$"loop count", Elastic1 QL file path=$"Elastic1 QL file path", Elastic2 QL file path=$"Elastic2 QL file path", QL1 Store Queue=$"QL1 Store Queue", QL2 Store Queue=$"QL2 Store Queue", Store Results=$"Store Results", Deficit1 Store Queue=$"Deficit2 Store Queue", Deficit2 Store Queue=$"Deficit1 Store Queue", Deficit1 file path=$"Deficit1 file path", Deficit2 file path=$"Deficit2 file path") -> (data transfer=w68, error out=w67, Data Logging Completed=w72)
            w69 = default
            w70 = default
            w71 = default
          }
          frame "Manual", Default {
            # Manual
            case ($"Trigger TX") {
              frame False, Default {
                w67 = s5
                w68 = $"Trigger TX"
              }
              frame True {
                Enqueue Element(element=w62, error in (no error)=s5, queue=w52, timeout in ms (-1)=-1) -> (error out=w67, queue out=w74)
                w68 = $"Trigger TX"
              }
            }
            w69 = default
            w70 = default
            w71 = default
            w72 = default
          }
        }
        $"Data Transfer 3" <- w71
        $"Data Transfer 2" <- w69
        $"Data Transfer" <- w68
        $"Data Transfer 4" <- w70
        $"Data Logging Completed" <- w72
        $"Data Transfer" <- w66
        $"FIFO Full" <- w64
        Merge Errors(w67, w65) -> (error out=w60)
      }
    }
    call "Check Stop.gvi"(error in=w60) -> (error out=w75, stop=w76)
    Logical Or(w76, $"Store Results") -> w77
    $"loop iteration generate" <- i1
    next s5 = w75
    next s6 = w61
    stop if w77
  }
  call "Stop On Error.gvi"(error in=s5) -> (error out=w78)
  Udp Close(connection ID=s6, error in (no error)=w78) -> (error out=w79)
  s7 = w8  # shift register
  while {
    w80 = $Station
    # configuration
    Feedback Node(Input=w80) -> (Output=w81)
    Logical Exclusive Or(w80, w81) -> w82
    call "802.11 Unbundle Session.gvi"(session_2=$session) -> (FPGA interface=w83)
    case (w82) {
      frame False, Default {
        w84 = s7
      }
      frame True {
        case (w80) {
          frame False, Default {
            sequence {
              frame 0 {
                $"Station Active" <- w80
              }
            }
            call "802.11 Unbundle Session.gvi"(session_2=$session) -> (UDP receiver=w85, UDP Receiver 2=w86)
            Udp Close(connection ID=w85, error in (no error)=s7) -> (error out=w87)
            Udp Close(connection ID=w86, error in (no error)=s7) -> (error out=w88)
            Merge Errors(w87, w88) -> (error out=w89)
            call "Clear Errors.gvi"(specific error code to clear=1, error in=w89) -> (error out=w90)
            call "802.11 Abort RF Streams.gvi"(session=$session, error in=w90) -> (error out=w84)
          }
          frame True {
            $"RX Frequency [Hz]" <- $"TX Frequency [Hz]"
            call "802.11 FPGA Target Configuration.gvi"() -> (maximum gain=w91)
            w92 = T23 {"remove header"=TRUE, "block unsupported frame types"=TRUE, "block FCS errors"=TRUE, "block address mismatch"=TRUE, "block header recognize error"=TRUE}
            call "802.11 Configure Static Parameters.gvi"(FPGA interface=w83, error in=s7, primary subband=$"Primary Subband", operation mode=$"Operation Mode", MPDU filter configuration=w92, device MAC address=$"Device MAC Address") -> (FPGA interface dup=w93, error out=w94)
            call "802.11 Reset Statistics.gvi"(FPGA interface=w93, error in=w94, reset RX statistics=TRUE, reset TX statistics=TRUE) -> (error out=w95)
            call "802.11 Configure TX RF.gvi"(TX port=$"TX Port (USRP only)", session=$session, TX frequency=$"TX Frequency [Hz]", TX power level=$"Power Level [dBm]", error in=w95) -> (session dup=w96, error out=w97, coerced TX power level=w98, coerced LO frequency=w99)
            call "802.11 Configure RX RF.gvi"(RX frequency=$"TX Frequency [Hz]", session=w96, RX gain=w91, error in=w97, RX port=$"RX Port (USRP only)") -> (error out=w100, session dup=w101, coerced RX gain=w102, coerced LO frequency=w103)
            call "802.11 Set Power Calibration Offset.gvi"(session=w101, frequency=$"TX Frequency [Hz]", error in=w100, RX port=$"RX Port (USRP only)") -> (error out=w104, session dup=w105)
            call "802.11 Configure RF Streams.gvi"(TX port=$"TX Port (USRP only)", RX port=$"RX Port (USRP only)", session=w105, error in=w104) -> (session dup=w106, error out=w107)
            call "802.11 Configure Data Source.gvi"(error in=w107, receive port=$"Receive Port", session=w106, receive port 2=$"Receive Port 2", receive port 3=$"Receive Port 3", receive port 4=$"Receive Port 4") -> (error out=w84, session out=w108, success?=w109)
            $session <- w108
            sequence {
              frame 0 {
                $Station <- w109
                $"Station Active" <- w80
              }
            }
            $"Coerced LO frequency RX [Hz]" <- w103
            $"Coerced RX Gain [dB]" <- w102
            $"Coerced LO frequency TX [Hz]" <- w99
            $"Coerced Power Level [dBm]" <- w98
          }
        }
      }
    }
    case ($"Station Active") {
      frame False, Default {
        w110 = s7
      }
      frame True {
        Feedback Node(Input=$"Station Active") -> (Output=w111)
        Is Not Equal(x=$"Station Active", y=w111) -> w112
        w113 = -25  # ADC target headroom [dBFS]
        w114 = -12  # Power Calibration Offset
        call "802.11 Calculate RX Gain.gvi"(RF RX power calibration offset=w114, FPGA interface=w83, reference in=$"Coerced RX Gain [dB]", ADC target headroom=w113, error in=s7, AGC=$AGC, manual RX gain=$"Manual RX gain [dB]", start AGC=w112) -> (error out=w115, ADC headroom=w116, RX gain=w117)
        Is Equal(x=$"Coerced RX Gain [dB]", y=w117) -> w118
        case (w118) {
          frame True {
            w119 = w115
            w120 = w117
          }
          frame False {
            call "802.11 Apply RX Gain.gvi"(session=$session, RX gain=w117, RX port=$"RX Port (USRP only)", RX frequency=$"RX Frequency [Hz]", error in=w115) -> (error out=w119, coerced RX gain=w120)
          }
        }
        $"Coerced RX Gain [dB]" <- w120
        call "802.11 Subcarrier Format to Configuration.gvi"(MCS=$MCS, subcarrier format=$"Subcarrier Format", error in=s7) -> (error out=w121, format=w122)
        call "802.11 Configure Dynamic Parameters.gvi"(FPGA interface=w83, error in=w121, format=w122, transmit ACK=$"Transmit ACK", backoff value=$Backoff, CCA energy detection threshold=$"CCA Energy Detection Threshold [dBm]") -> (error out=w123)
        Merge Errors(w119, w123) -> (error out=w110)
        $"Target RX gain [dB]" <- w117
        $"ADC headroom [dBFS]" <- w116
      }
    }
    call "802.11 Reset Statistics.gvi"(FPGA interface=w83, error in=s7, reset RX statistics=$"reset RX staistics", reset TX statistics=$"reset TX staistics") -> (error out=w124)
    call "802.11 Subcarrier Format to Configuration.gvi"(MCS=$MCS, subcarrier format=$"Subcarrier Format", error in=w124) -> (modulation and coding rate=w125, error out=w126)
    Merge Errors(w110, w84, w126) -> (error out=w127)
    case ($Stop) {
      frame False, Default {
        w128 = w127
      }
      frame True {
        w129 = error {"status"=TRUE, "code"=-44332211, "source"="stop on request"}
        Merge Errors(w127, w129) -> (error out=w128)
      }
    }
    call "Check Stop.gvi"(error in=w128) -> (error out=w130, stop=w131)
    Wait Until Next Ms Multiple(millisecond multiple=500)
    $"modulation and coding rate" <- w125
    next s7 = w130
    stop if w131
  }
  call "Stop On Error.gvi"(error in=s7) -> (error out=w132)
  s8 = w8  # shift register
  while (iteration -> i2) {
    # TX transmission
    call "802.11 Unbundle Session.gvi"(session_2=$session) -> (FPGA interface=w133, send queue=w134, send queue 2=w135, RT queue=w136, send queue 3=w137, send queue 4=w138)
    call "Queue Switch.gvi"(send queue=w134, send queue 2=w135, error in=s8, RT queue=w136, FPGA interface=w133, Deficit 2=$"Deficit 2", Deficit 1=$"Deficit 1", Destination 1 MAC=w51, send queue 3=w137, send queue 4=w138, Deficit2 Store Queue=$"Deficit2 Store Queue", Deficit1 Store Queue=$"Deficit1 Store Queue") -> (payload out=w139, error out=w140, timed out?=w141, RT Number=w142, Deficit 1 out=w143, Deficit 2 out=w144, Packet Dropped=w145)
    $"Packet Dropped?" <- w145
    Logical And(TRUE, not w141) -> w146
    case (w146) {
      frame False {
        w147 = w140
      }
      frame True {
        call "802.11 Subcarrier Format to Configuration.gvi"(MCS=$MCS, subcarrier format=$"Subcarrier Format", error in=w140) -> (error out=w148, format=w149, bandwidth=w150, valid configuration=w151)
        Is Not Equal(x=$"Operation Mode", y="RF Multi Station") -> w152
        Select(s=w152, t=$"Device MAC Address", f=$"Destination MAC Address 1") -> w153
        case (w151) {
          frame False, Default {
            w154 = FALSE
            w147 = w148
          }
          frame True {
            call "802.11 Send TX ICP.gvi"(FPGA interface=w133, MCS=$MCS, device MAC address=$"Device MAC Address", error in=w148, destination MAC address=w153, payload=w139, format=w149, bandwidth=w150) -> (dropped?=w154, error out=w147, TX Size=w155)
            $"TX Size" <- w155
          }
        }
        $"TX Data Dropped" <- w154
        $"Overwritten by Device MAC Address" <- w152
      }
    }
    call "Check Stop.gvi"(error in=w147) -> (error out=w156, stop=w157)
    call "Check Stop.gvi"(error in=w156) -> (error out=w158, stop=w159)
    $"RT Number" <- w142
    $"Deficit 1" <- w143
    $"Deficit 2" <- w144
    Logical Or(w157, FALSE)
    Wait Until Next Ms Multiple(millisecond multiple=0)
    Get Queue Status(queue=w137) -> (# elements in queue=w160)
    $"number elements in queue" <- w160
    $"loop iteration send" <- i2
    Get Queue Status(queue=w138) -> (# elements in queue=w161)
    $"number elements in queue_2" <- w161
    next s8 = w158
    stop if w159
  }
  call "Stop On Error.gvi"(error in=s8) -> (error out=w162)
  Merge Errors(w132, w162, w15, w79, w36, w46) -> (error out=w163)
  call "Clear Errors.gvi"(specific error code to clear=w1, error in=w163) -> (error out=w164)
  sequence {
    frame 0 {
      w165 = $session
    }
  }
  call "802.11 Host Release.gvi"(session=w165, error in=w164) -> (error out=w166)
  call "Simple Error Handler.gvi"(type of dialog="OK message", error in=w166)
