vi "Analyze Deadline 2.gvi"   [LabVIEW NXG]
inputs:
  "payload in": u8[]
outputs:
  "Packet Expired?": bool
panel indicators:
  "sum": f64
diagram:
  Array Index(array=$"payload in") -> (out0[1]=w1)
  Array Index(array=$"payload in") -> (out0[0]=w2)
  Multiply(w2, 60) -> w3
  Array Index(array=$"payload in") -> (out0[2]=w4)
  Array Index(array=$"payload in") -> (out0[3]=w5)
  Join Numbers(high(x)=w4, low(x)=w5) -> w6
  Divide(x=w6, y=10000) -> w7
  Add(w3, w1, w7) -> w8
  Get Current Time() -> (current time=w9)
  Timestamp To Date Time(time stamp=w9) -> (date time rec=w10)
  Property Node(instance in=w10) -> ("fractional second"=w11, "second"=w12, "minute"=w13)
  Multiply(w13, 60) -> w14
  Add(w11, w12, w14) -> w15
  Is Less(x=w8, y=w15) -> w16
  $"Packet Expired?" <- w16
  $sum <- w15
  Format Date Time String(time format string (%c)="%S", time stamp=w9) -> (date/time string=w17)
  Decimal String To Number(string=w17) -> (number=w18)
  To Unsigned Byte Integer(number=w18)
  Format Date Time String(time format string (%c)="%4u", time stamp=w9) -> (date/time string=w19)
  Decimal String To Number(offset=1, string=w19) -> (number=w20)
  To Unsigned Word Integer(number=w20) -> w21
  Split Number(x=w21)
