vi "Analyze Deadline.gvi"   [LabVIEW NXG]
inputs:
  "payload in": u8[]
outputs:
  "Packet expired (tick)?": bool
diagram:
  Array Index(array=$"payload in") -> (out0[0]=w1)
  Array Index(array=$"payload in") -> (out0[1]=w2)
  Join Numbers(high(x)=w1, low(x)=w2) -> w3
  Array Index(array=$"payload in") -> (out0[2]=w4)
  Array Index(array=$"payload in") -> (out0[3]=w5)
  Join Numbers(high(x)=w4, low(x)=w5) -> w6
  Join Numbers(high(x)=w3, low(x)=w6) -> w7
  Tick Count() -> (millisecond timer value=w8)
  Is Less(x=w7, y=w8) -> w9
  $"Packet expired (tick)?" <- w9
