vi "Configure FPGA MAC.gvi"   [LabVIEW NXG]
inputs:
  "FPGA Reference In": any
  "FPGA MAC Controls": cluster{"time to wait for ACK": u32} = {"time to wait for ACK"=700}
  "error in": error
outputs:
  "error out": error
panel controls:
  "FPGA Interface": any
diagram:
  Type Cast(type=$"FPGA Interface", x=$"FPGA Reference In") -> w1
  Property Node(instance in=$"FPGA MAC Controls") -> ("time to wait for ACK"=w2)
  Property Node(instance in=w1, error in=$"error in", "time to wait for decoding packet"=w2, "time to wait for CCA signal detect"=3000) -> (error out=w3)
  $"error out" <- w3
