vi "Deficit Decrement.gvi"   [LabVIEW NXG]
inputs:
  "Deficit 1": f64
  "Deficit 2": f64
  "payload": u8[]
  "Destination 1 MAC": u8[6]
outputs:
  "Deficit 1 out": f64
  "Deficit 2 out": f64
diagram:
  Array Index(array=$"Destination 1 MAC") -> (out0[5]=w1)
  Array Index(array=$payload) -> (out0[10]=w2)
  Is Equal(x=w1, y=w2) -> w3
  # Compare with Destination 1 MAC, and decrement deficit if its a Real-Time Flow.
  # DR #1 = 0.85
  # DR #2 = 0.8
  case (w3) {
    frame False, Default {
      Array Index(array=$payload) -> (out0[11]=w6)
      case (w6) {
        frame 98 {
          w5 = $"Deficit 2"
        }
        frame 97, Default {
          Subtract(x=$"Deficit 2", y=0.1) -> w5
        }
      }
      w4 = $"Deficit 1"
    }
    frame True {
      Array Index(array=$payload) -> (out0[11]=w7)
      case (w7) {
        frame 98 {
          w4 = $"Deficit 1"
        }
        frame 97, Default {
          Subtract(x=$"Deficit 1", y=0.1) -> w4
        }
      }
      w5 = $"Deficit 2"
    }
  }
  $"Deficit 1 out" <- w4
  $"Deficit 2 out" <- w5
