vi "DeficitToFile.gvi"   [LabVIEW NXG]
inputs:
  "Deficit2 file path": path
  "Deficit1 file path": path
  "Deficit1 Cluster Queue": Queue<T1>
  "Store Results": bool
  "Deficit2 Cluster Queue": Queue<T1>
outputs:
  "Logging Completed": bool
types:
  T1 = cluster{"Element 1": f64, "Element 2": timestamp}
diagram:
  case ($"Store Results") {
    frame False, Default {
      w1 = default
    }
    frame True {
      Get Queue Status(queue=$"Deficit1 Cluster Queue") -> (# elements in queue=w2)
      for (N = w2) (iteration -> i1) {
        Dequeue Element(queue=$"Deficit1 Cluster Queue", timeout in ms (-1)=0) -> (element=w3)
        Property Node(instance in=w3) -> ("Element 1"=w4, "Element 2"=w5)
        Number To Fractional String(number=w4, precision (6)=2) -> (F-format string=w6)
        Timestamp To Date Time(time stamp=w5) -> (date time rec=w7)
        Property Node(instance in=w7) -> ("fractional second"=w8)
        Number To Fractional String(number=w8, precision (6)=3) -> (F-format string=w9)
        Get Date Time String(time stamp=w5, want seconds? (F)=TRUE) -> (time string=w10)
        Concatenate Strings(w6, " ", w10, " ", w9, "\r\n")
        Build Array(w6, w10, w9) -> w11
        call "Write to Spreadsheet File (string).gvi"(file path=$"Deficit1 file path", 1D data=w11, append to file?=TRUE, delimiter=",")
        Dequeue Element(queue=$"Deficit2 Cluster Queue", timeout in ms (-1)=0) -> (element=w12)
        Property Node(instance in=w12) -> ("Element 1"=w13, "Element 2"=w14)
        Number To Fractional String(number=w13, precision (6)=2) -> (F-format string=w15)
        Timestamp To Date Time(time stamp=w14) -> (date time rec=w16)
        Property Node(instance in=w16) -> ("fractional second"=w17)
        Number To Fractional String(number=w17, precision (6)=3) -> (F-format string=w18)
        Get Date Time String(time stamp=w14, want seconds? (F)=TRUE) -> (time string=w19)
        Concatenate Strings(w15, " ", w19, " ", w18, "\r\n")
        Build Array(w15, w19, w18) -> w20
        call "Write to Spreadsheet File (string).gvi"(file path=$"Deficit2 file path", 1D data=w20, append to file?=TRUE, delimiter=",")
        Add(1, i1) -> w21
        Is Greater Or Equal(x=w21, y=w2) -> w1
      }
    }
  }
  $"Logging Completed" <- w1
