vi "Dequeue after Deadline Check 2.gvi"   [LabVIEW NXG]
inputs:
  "Deficit 2": f64
  "send queue 2": Queue<u8[]>
  "error in": error
  "send queue 4": Queue<u8[]>
outputs:
  "error out": error
  "Deficit 2 out": f64
  "payload": u8[]
  "Packet Dropped?": bool
  "timed out?": bool
diagram:
  # Client 2 elastic
  # Client 2 inelastic
  Get Queue Status(queue=$"send queue 2") -> (# elements in queue=w1)
  Is Greater Than 0(x=w1) -> w2
  # DR #1 = 0.9
  # DR #2 = 0.9
  # If DBQ is empty, schedule the elastic flow
  case (w2) {
    frame False, Default {
      Dequeue Element(error in (no error)=$"error in", queue=$"send queue 4", timeout in ms (-1)=0) -> (element=w5, error out=w3, timed out?=w4)
      w6 = $"Deficit 2"
      w7 = default
    }
    frame True {
      Preview Queue Element(queue=$"send queue 2", timeout in ms (-1)=0) -> (element=w8)
      call "Analyze Deadline.gvi"(payload in=w8) -> (Packet expired (tick)?=w9)
      case (w9) {
        frame False, Default {
          Dequeue Element(error in (no error)=$"error in", queue=$"send queue 2", timeout in ms (-1)=0) -> (element=w5, error out=w3, timed out?=w4)
          w6 = $"Deficit 2"
          w7 = default
        }
        frame True {
          Dequeue Element(error in (no error)=$"error in", queue=$"send queue 2", timeout in ms (-1)=0) -> (error out=w3)
          Add(0.9, $"Deficit 2") -> w6
          w4 = TRUE
          w5 = default
          w7 = TRUE
        }
      }
    }
  }
  $"Packet Dropped?" <- w7
  $payload <- w5
  $"timed out?" <- w4
  $"error out" <- w3
  $"Deficit 2 out" <- w6
