vi "Dequeue after Deadline Check.gvi"   [LabVIEW NXG]
inputs:
  "send queue 1": Queue<u8[]>
  "error in": error
  "send queue 3": Queue<u8[]>
  "Deficit 1": f64
outputs:
  "error out": error
  "payload": u8[]
  "timed out?": bool
  "Deficit 1 out": f64
  "Packet Dropped?": bool
diagram:
  # Client 1 elastic
  # Client 1 inelastic
  Get Queue Status(queue=$"send queue 1") -> (# elements in queue=w1)
  Is Greater Than 0(x=w1) -> w2
  # DR #1 = 0.9
  # DR #2 = 0.9
  # If DBQ is empty, schedule the elastic flow
  case (w2) {
    frame False, Default {
      Dequeue Element(error in (no error)=$"error in", queue=$"send queue 3", timeout in ms (-1)=0) -> (element=w5, error out=w3, timed out?=w4)
      w6 = $"Deficit 1"
      w7 = default
    }
    frame True {
      Preview Queue Element(queue=$"send queue 1", timeout in ms (-1)=0) -> (element=w8)
      call "Analyze Deadline.gvi"(payload in=w8) -> (Packet expired (tick)?=w9)
      case (w9) {
        frame False, Default {
          Dequeue Element(error in (no error)=$"error in", queue=$"send queue 1", timeout in ms (-1)=0) -> (element=w5, error out=w3, timed out?=w4)
          w6 = $"Deficit 1"
          w7 = default
        }
        frame True {
          Dequeue Element(error in (no error)=$"error in", queue=$"send queue 1", timeout in ms (-1)=0) -> (error out=w3)
          Add(0.9, $"Deficit 1") -> w6
          w4 = TRUE
          w5 = default
          w7 = TRUE
        }
      }
    }
  }
  $"Packet Dropped?" <- w7
  $payload <- w5
  $"timed out?" <- w4
  $"error out" <- w3
  $"Deficit 1 out" <- w6
