vi "Flow Scheduler.gvi"   [LabVIEW NXG]
inputs:
  "send queue 2": Queue<u8[]>
  "send queue": Queue<u8[]>
  "Error In": error
outputs:
  "DBQs Not empty?": bool
  "Error Out": error
diagram:
  Get Queue Status(error in (no error)=$"Error In", queue=$"send queue") -> (# elements in queue=w1, error out=w2)
  Get Queue Status(error in (no error)=$"Error In", queue=$"send queue 2") -> (# elements in queue=w3, error out=w4)
  Merge Errors(w2, w4) -> (error out=w5)
  $"Error Out" <- w5
  Is Less(x=w1, y=1) -> w6
  Is Less(x=w3, y=1) -> w7
  Logical And[output inverted](w6, w7) -> w8
  $"DBQs Not empty?" <- w8
