vi "Host Retransmission.gvi"   [LabVIEW NXG]
inputs:
  "RT Queue In": Queue<string>
  "RT Limit": u32 = 100000
  "# of ACK Received": u32
  "# of ACK Timeout": u32
  "Packet Expired?": bool
outputs:
  "RT Queue Out": Queue<string>
  "State": T1
  "RT Queue Empty?": bool
types:
  T1 = enum{"Idle", "ACK Received", "ACK Timeout and Packet Valid", "ACK Timeout and Packet Expires"}
diagram:
  # Case loop in triggered by
  # (1) # of ACK Received increases
  # (2) # of ACK Timeout increases
  Feedback Node(Input=w1) -> (Output=w2)
  Is Greater(x=$"# of ACK Received", y=w2) -> w3
  Feedback Node(Input=w4) -> (Output=w5)
  Is Greater(x=$"# of ACK Timeout", y=w5) -> w6
  Logical Or(w3, w6) -> w7
  Select(s=$"Packet Expired?", t="ACK Timeout and Packet Expires", f="ACK Timeout and Packet Valid") -> w8
  Select(s=w3, t="ACK Received", f=w8) -> w9
  Select(s=w7, t=w9, f="Idle") -> w10
  # Last Modified by Ping-Chun
  # 09/01/2016
  case (w10) {
    frame "Idle", Default {
      w1 = $"# of ACK Received"
      w4 = $"# of ACK Timeout"
      w11 = default
    }
    frame "ACK Received" {
      # If ACK is received, then just dequeue the current packet
      Dequeue Element(queue=$"RT Queue In") -> (element=w12, queue out=w11)
      w1 = $"# of ACK Received"
      w4 = $"# of ACK Timeout"
    }
    frame "ACK Timeout and Packet Valid" {
      Dequeue Element(queue=$"RT Queue In") -> (element=w13, queue out=w11)
      # Dequeue and Enqueue again for retransmission
      Enqueue Element At Opposite End(element=w13, queue=$"RT Queue In")
      w1 = $"# of ACK Received"
      w4 = $"# of ACK Timeout"
    }
    frame "ACK Timeout and Packet Expires" {
      # If packet expires, then dequeue the current packet anyway
      Dequeue Element(queue=$"RT Queue In") -> (element=w14, queue out=w11)
      w1 = $"# of ACK Received"
      w4 = $"# of ACK Timeout"
    }
  }
  $"RT Queue Out" <- w11
  Get Queue Status(queue=$"RT Queue In", return elements? (F)=TRUE) -> (# elements in queue=w15)
  Is Equal To 0(x=w15) -> w16
  $"RT Queue Empty?" <- w16
  $State <- w10
