vi "LQF Switch.gvi"   [LabVIEW NXG]
inputs:
  "Error In": error
  "send queue 3": Queue<u8[]>
  "send queue 4": Queue<u8[]>
outputs:
  "Error Out": error
  "timed out?": bool
  "payload out": u8[]
diagram:
  Get Queue Status(error in (no error)=$"Error In", queue=$"send queue 3", return elements? (F)=TRUE) -> (# elements in queue=w1, error out=w2, queue out=w3)
  Get Queue Status(error in (no error)=$"Error In", queue=$"send queue 4", return elements? (F)=TRUE) -> (# elements in queue=w4, error out=w5, queue out=w6)
  Is Greater(x=w1, y=w4) -> w7
  Merge Errors(w2, w5) -> (error out=w8)
  # To be used when LQF switching is done randomly. (Doing DBQ for all)
  case (w7) {
    frame False, Default {
      Dequeue Element(error in (no error)=w8, queue=w6, timeout in ms (-1)=0) -> (element=w10, error out=w9, timed out?=w11)
    }
    frame True {
      Dequeue Element(error in (no error)=w8, queue=w3, timeout in ms (-1)=0) -> (element=w10, error out=w9, timed out?=w11)
    }
  }
  $"payload out" <- w10
  $"timed out?" <- w11
  $"Error Out" <- w9
