vi "Prefix Deadline 2.gvi"   [LabVIEW NXG]
outputs:
  "Deadline Prefix": u8[]
panel indicators:
  "sum": f64
  "unsigned 32-bit integer": u32
  "seconds": string
  "milliseconds": string
  "minutes": string
diagram:
  Get Current Time() -> (current time=w1)
  Timestamp To Date Time(time stamp=w1) -> (date time rec=w2)
  Property Node(instance in=w2) -> ("fractional second"=w3, "second"=w4)
  Add(w3, w4) -> w5
  $sum <- w5
  To Unsigned Long Integer(number=w5) -> w6
  $"unsigned 32-bit integer" <- w6
  Format Date Time String(time format string (%c)="%M", time stamp=w1) -> (date/time string=w7)
  $minutes <- w7
  Format Date Time String(time format string (%c)="%S", time stamp=w1) -> (date/time string=w8)
  $seconds <- w8
  Decimal String To Number(string=w8) -> (number=w9)
  To Unsigned Byte Integer(number=w9) -> w10
  # Add Deadline here
  Add(w10, 5) -> w11
  Quotient And Remainder(x=w11, y=60) -> (floor(x/y)=w12, x-y*floor(x/y)=w13)
  Format Date Time String(time format string (%c)="%4u", time stamp=w1) -> (date/time string=w14)
  # Add deadline value here
  Decimal String To Number(offset=1, string=w14) -> (number=w15)
  To Unsigned Word Integer(number=w15) -> w16
  Split Number(x=w16) -> (high(x)=w17, low(x)=w18)
  Decimal String To Number(string=w7) -> (number=w19)
  To Unsigned Byte Integer(number=w19) -> w20
  Add(w20, w12) -> w21
  Build Array(w21, w13, w17, w18) -> w22
  $"Deadline Prefix" <- w22
  $milliseconds <- w14
