vi "Prefix Deadline.gvi"   [LabVIEW NXG]
inputs:
  "deadline": u32
outputs:
  "Deadline Prefix": u8[]
  "Deadline Tick": u8[]
diagram:
  # Add Deadline here
  Tick Count() -> (millisecond timer value=w1)
  # Add Deadline here
  Add(w1, $deadline) -> w2
  Split Number(x=w2) -> (high(x)=w3, low(x)=w4)
  Split Number(x=w3) -> (high(x)=w5, low(x)=w6)
  Split Number(x=w4) -> (high(x)=w7, low(x)=w8)
  Build Array(w5, w6, w7, w8) -> w9
  $"Deadline Tick" <- w9
