vi "QL & Deficits To File.gvi"   [LabVIEW NXG]
inputs:
  "Elastic1 QL file path": path
  "Elastic2 QL file path": path
  "QL1 Store Queue": Queue<u32[]>
  "Store Results": bool
  "QL2 Store Queue": Queue<u32[]>
  "Deficit1 Store Queue": Queue<f64[]>
  "Deficit2 Store Queue": Queue<f64[]>
  "Deficit1 file path": path
  "Deficit2 file path": path
outputs:
  "QL Logging Completed": bool
diagram:
  case ($"Store Results") {
    frame False, Default {
      w1 = default
    }
    frame True {
      Get Queue Status(queue=$"QL1 Store Queue") -> (# elements in queue=w2)
      for (N = w2) (iteration -> i1) {
        Dequeue Element(queue=$"QL1 Store Queue", timeout in ms (-1)=0) -> (element=w3)
        Array Index(array=w3) -> (out0[0]=w4)
        Number To Decimal String(number=w4) -> (decimal integer string=w5)
        Array Index(array=w3) -> (out0[1]=w6)
        Number To Decimal String(number=w6) -> (decimal integer string=w7)
        Build Array(w5, w7) -> w8
        call "Write to Spreadsheet File (string).gvi"(file path=$"Elastic1 QL file path", 1D data=w8, append to file?=TRUE, delimiter=",")
        Dequeue Element(queue=$"QL2 Store Queue", timeout in ms (-1)=0) -> (element=w9)
        Array Index(array=w9) -> (out0[0]=w10)
        Number To Decimal String(number=w10) -> (decimal integer string=w11)
        Array Index(array=w9) -> (out0[1]=w12)
        Number To Decimal String(number=w12) -> (decimal integer string=w13)
        Build Array(w11, w13) -> w14
        call "Write to Spreadsheet File (string).gvi"(file path=$"Elastic2 QL file path", 1D data=w14, append to file?=TRUE, delimiter=",")
        Dequeue Element(queue=$"Deficit1 Store Queue", timeout in ms (-1)=0) -> (element=w15)
        Array Index(array=w15) -> (out0[0]=w16)
        Number To Fractional String(number=w16, precision (6)=2) -> (F-format string=w17)
        Array Index(array=w15) -> (out0[1]=w18)
        Number To Decimal String(number=w18) -> (decimal integer string=w19)
        Build Array(w17, w19) -> w20
        call "Write to Spreadsheet File (string).gvi"(file path=$"Deficit1 file path", 1D data=w20, append to file?=TRUE, delimiter=",")
        Dequeue Element(queue=$"Deficit2 Store Queue", timeout in ms (-1)=0) -> (element=w21)
        Array Index(array=w21) -> (out0[0]=w22)
        Number To Fractional String(number=w22, precision (6)=2) -> (F-format string=w23)
        Array Index(array=w21) -> (out0[1]=w24)
        Number To Decimal String(number=w24) -> (decimal integer string=w25)
        Build Array(w23, w25) -> w26
        call "Write to Spreadsheet File (string).gvi"(file path=$"Deficit2 file path", 1D data=w26, append to file?=TRUE, delimiter=",")
        Add(1, i1) -> w27
        Is Greater Or Equal(x=w27, y=w2) -> w1
      }
    }
  }
  $"QL Logging Completed" <- w1
