vi "Queue Switch.gvi"   [LabVIEW NXG]
inputs:
  "send queue": Queue<u8[]>
  "send queue 2": Queue<u8[]>
  "error in": error
  "RT queue": Queue<u8[]>
  "FPGA interface": any
  "Deficit 2": f64
  "Deficit 1": f64
  "Destination 1 MAC": u8[6]
  "send queue 3": Queue<u8[]>
  "send queue 4": Queue<u8[]>
  "Deficit2 Store Queue": Queue<f64[]>
  "Deficit1 Store Queue": Queue<f64[]>
outputs:
  "payload out": u8[]
  "error out": error
  "timed out?": bool
  "RT Number": u8
  "Deficit 1 out": f64
  "Deficit 2 out": f64
  "Packet Dropped": bool
panel controls:
  "FPGA reference": any
panel indicators:
  "RT Queue Empty?": bool
diagram:
  Get Queue Status(error in (no error)=$"error in", queue=$"RT queue", return elements? (F)=TRUE) -> (# elements in queue=w1, error out=w2)
  Is Equal To 0(x=w1) -> w3
  case (w3) {
    frame False, Default {
      Preview Queue Element(error in (no error)=w2, queue=$"RT queue", timeout in ms (-1)=0) -> (element=w6, error out=w5)
      call "Analyze Deadline.gvi"(payload in=w6) -> (Packet expired (tick)?=w4)
    }
    frame True {
      # Set Packet expired to be true
      # (Doesn't Matter)
      w4 = FALSE
      w5 = w2
    }
  }
  Type Cast(type=$"FPGA reference", x=$"FPGA interface") -> w7
  Property Node(instance in=w7) -> ("# of ack received"=w8, "# of ACK timeout"=w9)
  # Check if RT Queue is empty or not =>
  # 	Yes - Enter into this case structure and choose b/w the 2 queues.
  # 	No - Enter into RT VI and dequeue/drop from there
  call "802.11 Host Retransmission.gvi"(RT Queue In=$"RT queue", RT Limit=100000, # of ACK Received=w8, # of ACK Timeout=w9, Packet Expired?=w4, Error In=w5, Deficit 1=$"Deficit 1", Deficit 2=$"Deficit 2", Destination 1 MAC=$"Destination 1 MAC") -> (RT Queue Out=w10, RT payload=w11, timed out?=w12, RT Number=w13, Error Out=w14, Deficit 2 out=w15, Deficit 1 out=w16, Packet dropped=w17)
  $"RT Number" <- w13
  # w15: Deficit 2
  Get Queue Status(error in (no error)=w14, queue=w10, return elements? (F)=TRUE) -> (# elements in queue=w18, error out=w19)
  Is Equal To 0(x=w18) -> w20
  Merge Errors(w19, $"error in") -> (error out=w21)
  # TO ADD: Deficit 1 and Deficit 2. And logic to modify them appropraitely in each case.
  # OVERALL FLOW:-
  # Check if RT is not empty =>
  # 	Yes - Enter into RT VI and dequeue/drop from there
  # 	No - Enter into this case structure and then, AnalyzeDeadline and Transmit (sending copy to RT) OR DropPacket
  # w16: Deficit 1
  case (w20) {
    frame False, Default {
      w22 = w11
      w23 = w12
      w24 = w21
      w25 = w16
      w26 = w15
      w27 = w17
    }
    frame True {
      call "Flow Scheduler.gvi"(send queue 2=$"send queue 2", send queue=$"send queue", Error In=w21) -> (DBQs Not empty?=w28, Error Out=w29)
      case (w28) {
        frame False, Default {
          call "Unscheduled Queue 1 Poll.gvi"(Deficit 1=w16, send queue 1=$"send queue", error in=w29) -> (Deficit 1 Out=w25, error out=w31)
          call "Unscheduled Queue 2 Poll.gvi"(Deficit 2=w15, send queue 2=$"send queue 2", error in=w29) -> (Deficit 2 Out=w26, error out=w32)
          call "LQF Switch.gvi"(Error In=w29, send queue 3=$"send queue 3", send queue 4=$"send queue 4") -> (Error Out=w33, timed out?=w23, payload out=w22)
          Merge Errors(w31, w32, w33) -> (error out=w30)
        }
        frame True {
          call "Random Decision.gvi"(Deficit 1=w16, Deficit 2=w15, send queue=$"send queue", send queue 2=$"send queue 2") -> (DBQ 1 scheduled?=w34)
          case (w34) {
            frame False, Default {
              call "Dequeue after Deadline Check 2.gvi"(Deficit 2=w15, send queue 2=$"send queue 2", error in=w29, send queue 4=$"send queue 4") -> (error out=w35, Deficit 2 out=w26, payload=w22, Packet Dropped?=w36, timed out?=w23)
              call "Unscheduled Queue 1 Poll.gvi"(Deficit 1=w16, send queue 1=$"send queue", error in=w29) -> (Deficit 1 Out=w25, error out=w37, packet dropped?=w38)
              Logical Or(w36, w38) -> w39
              Merge Errors(w35, w37) -> (error out=w30)
            }
            frame True {
              call "Dequeue after Deadline Check.gvi"(send queue 1=$"send queue", error in=w29, send queue 3=$"send queue 3", Deficit 1=w16) -> (error out=w40, payload=w22, timed out?=w23, Deficit 1 out=w25, Packet Dropped?=w41)
              call "Unscheduled Queue 2 Poll.gvi"(Deficit 2=w15, send queue 2=$"send queue 2", error in=w29) -> (Deficit 2 Out=w26, error out=w42, packet dropped?=w43)
              Logical Or(w41, w43) -> w44
              Merge Errors(w40, w42) -> (error out=w30)
            }
          }
        }
      }
      # Send a copy
      # to RT queue
      Is Empty Array(array=w22) -> w45
      case (w45) {
        frame False, Default {
          Enqueue Element(element=w22, error in (no error)=w30, queue=w10) -> (error out=w24)
        }
        frame True {
          w24 = w30
        }
      }
      Is Empty Array(array=w22) -> w27
    }
  }
  $"error out" <- w24
  $"RT Queue Empty?" <- w3
  In Range And Coerce(lower limit=0, upper limit=+Inf, x=w25) -> (coerced(x)=w46)
  Tick Count() -> (millisecond timer value=w47)
  Build Array(w46, w47) -> w48
  Enqueue Element(element=w48, queue=$"Deficit1 Store Queue", timeout in ms (-1)=-1)
  $"payload out" <- w22
  $"timed out?" <- w23
  $"Deficit 1 out" <- w46
  In Range And Coerce(lower limit=0, upper limit=+Inf, x=w26) -> (coerced(x)=w49)
  $"Deficit 2 out" <- w49
  Tick Count() -> (millisecond timer value=w50)
  Build Array(w49, w50) -> w51
  Enqueue Element(element=w51, queue=$"Deficit2 Store Queue", timeout in ms (-1)=-1)
  $"Packet Dropped" <- w27
