vi "QueueLength2ToFile.gvi"   [LabVIEW NXG]
inputs:
  "Elastic QL file path": path
  "Queue Length": i32
diagram:
  Number To Decimal String(number=$"Queue Length") -> (decimal integer string=w1)
  Get Current Time() -> (current time=w2)
  Timestamp To Date Time(time stamp=w2) -> (date time rec=w3)
  Property Node(instance in=w3) -> ("fractional second"=w4)
  Number To Fractional String(number=w4, precision (6)=3) -> (F-format string=w5)
  Get Date Time String(time stamp=w2, want seconds? (F)=TRUE) -> (time string=w6)
  Concatenate Strings(w1, " ", w6, " ", w5, "\r\n")
  Build Array(w1, w6, w5) -> w7
  call "Write to Spreadsheet File (string).gvi"(file path=$"Elastic QL file path", 1D data=w7, append to file?=TRUE, delimiter=",")
