vi "Random Decision.gvi"   [LabVIEW NXG]
inputs:
  "Deficit 1": f64
  "Deficit 2": f64
  "send queue": Queue<u8[]>
  "send queue 2": Queue<u8[]>
outputs:
  "DBQ 1 scheduled?": bool
panel controls:
  "Turn": u8
panel indicators:
  "x <= y?": bool
  "x = 0?": bool
diagram:
  Is Equal To 0(x=$Turn) -> w1
  $"x = 0?" <- w1
  Is Greater(x=$"Deficit 1", y=$"Deficit 2") -> w2
  case (w2) {
    frame False, Default {
      Get Queue Status(queue=$"send queue 2") -> (# elements in queue=w4)
      Is Greater Than 0(x=w4) -> w5
      Not(x=w5) -> w3
    }
    frame True {
      Get Queue Status(queue=$"send queue") -> (# elements in queue=w6)
      Is Greater Than 0(x=w6) -> w3
    }
  }
  $"DBQ 1 scheduled?" <- w3
  Random Number() -> (number (0 to 1)=w7)
  Multiply(w7, 10) -> w8
  Round To Nearest(number=w8) -> w9
  Is Less Or Equal(x=w9, y=5) -> w10
  $"x <= y?" <- w10
