vi "Unscheduled Queue 2 Poll.gvi"   [LabVIEW NXG]
inputs:
  "Deficit 2": f64
  "send queue 2": Queue<u8[]>
  "error in": error
outputs:
  "Deficit 2 Out": f64
  "error out": error
  "packet dropped?": bool
diagram:
  Get Queue Status(queue=$"send queue 2") -> (# elements in queue=w1)
  Is Greater Than 0(x=w1) -> w2
  case (w2) {
    frame False, Default {
      w3 = $"error in"
      w4 = $"Deficit 2"
      w5 = FALSE
    }
    frame True {
      Preview Queue Element(error in (no error)=$"error in", queue=$"send queue 2", timeout in ms (-1)=0) -> (element=w6, error out=w7)
      call "Analyze Deadline.gvi"(payload in=w6) -> (Packet expired (tick)?=w8)
      case (w8) {
        frame False, Default {
          w3 = w7
          w4 = $"Deficit 2"
          w5 = default
        }
        frame True {
          Dequeue Element(error in (no error)=w7, queue=$"send queue 2", timeout in ms (-1)=0) -> (error out=w3)
          Add($"Deficit 2", 0.9) -> w4
          w5 = TRUE
        }
      }
    }
  }
  $"packet dropped?" <- w5
  $"error out" <- w3
  $"Deficit 2 Out" <- w4
